# Grasshopper definition walkability.gh (Grasshopper 1.0.7)
# plug-ins: Anemone

# path division length
number_slider = Slider(1, range=0..1)
# how accurate (large is accurate)
number_slider_2 = Slider(2, range=0..10000)
# start point
# iwha
start_pt = Point(Point(630.2929192, -21.12689802, 0))
# end point
pt = Point(Point(614.658905, 212.5202621, -7))
# initial point for direction
previus_pt = Point(Point(630.5317847, -23.91366217, 0))
# The surface
srf = Surface(<surface referenced from the Rhino model>)
# path division length
# yeonsei
number_slider_3 = Slider(1, range=0..1)
# how accurate (large is accurate)
number_slider_4 = Slider(2, range=0..10000)
# path division length
# SNU
number_slider_5 = Slider(1, range=0..1)
# how accurate (large is accurate)
number_slider_6 = Slider(2, range=0..10000)
# start point
start_pt_2 = Point(<point referenced from the Rhino model>)
# initial point for direction
previus_pt_2 = Point(<point referenced from the Rhino model>)
# end point
pt_2 = Point(<point referenced from the Rhino model>)
# start point
start_pt_3 = Point(Point(225.239102, 183.763165, 0))
# initial point for direction
previus_pt_3 = Point(Point(222.5879279, 187.5126827, 0))
# end point
pt_3 = Point(Point(465.5353412, -70.76440443, 0))
# The surface
srf_2 = Surface(<surface referenced from the Rhino model>)
# The surface
srf_3 = Surface(<surface referenced from the Rhino model>)

# ---- group: final 0408
# added randomness
# The surface
# initial point for direction
# path division length
# foreign language univ
# start point
# how accurate (large is accurate)
# end point
# 3d line
# planar line
# direct line
number_slider_7 = Slider(1, range=0..1)
start_pt_4 = Point(<point referenced from the Rhino model>)
previus_pt_4 = Point(<point referenced from the Rhino model>)
pt_4 = Point(<point referenced from the Rhino model>)
srf_4 = Surface(<surface referenced from the Rhino model>)
xy = XYPlane(Origin=Point(0, 0, 0))
bbox = BoundingBox(Content=srf_4, Plane=xy, UnionBox=False)  # -> Box, Box_2
debox = DeconstructBox(Box=bbox.Box)  # -> Plane, X, Y, Z
vec2pt = Vector2Pt(PointA=previus_pt_4, PointB=start_pt_4, Unitize=False)  # -> Vector, Length
dedomain = DeconstructDomain(Domain=debox.X)  # -> Start, End
dedomain_2 = DeconstructDomain(Domain=debox.Z)  # -> Start, End
dedomain_3 = DeconstructDomain(Domain=debox.Y)  # -> Start, End
fastloopstart = FastLoopStart(I=Slider(600, range=0..1000), D0=start_pt_4, D1=vec2pt.Vector)  # -> port, Counter, Data, Data_2, Data_3
pt_5 = ConstructPoint(XCoordinate=dedomain.Start, YCoordinate=dedomain_3.Start, ZCoordinate=dedomain_2.Start)
pt_6 = ConstructPoint(XCoordinate=dedomain.End, YCoordinate=dedomain_3.End, ZCoordinate=dedomain_2.End)
vec2pt_2 = Vector2Pt(PointA=previus_pt_4, PointB=fastloopstart.Data, Unitize=False)  # -> Vector, Length
xy_2 = XYPlane(Origin=Point(0, 0, 0))
dist = Distance(PointA=pt_5, PointB=pt_6)
multiplication = Multiplication(A=dist, B=2)
project = Project(Geometry=srf_4, Plane=xy_2)  # -> Geometry, Transform
wires = BrepWireframe(Brep=project.Geometry, Density=-1)
edges = BrepEdges(Brep=project.Geometry)  # -> Naked, Interior, NonManifold
join = JoinCurves(Curves=edges.Naked, Preserve=False)
crv_cp = CurveClosestPoint(Point=fastloopstart.Data, Curve=join)  # -> Point, Parameter, Distance
vec2pt_3 = Vector2Pt(PointA=crv_cp.Point, PointB=fastloopstart.Data, Unitize=False)  # -> Vector, Length
line = LineSDL(Start=crv_cp.Point, Direction=vec2pt_3.Vector, Length=dist)
cluster = Cluster(crv=join, L=dist, pt=fastloopstart.Data)
shift = ShiftList(List=cluster, Shift=1, Wrap=False)
Z = UnitZ(Factor=1)
previus_vector = Vector(fastloopstart.Data_2)
ccx = CurveCurve(CurveA=line, CurveB=join)  # -> Points, ParamsA, ParamsB
short = ShortestList(ListA=cluster, ListB=shift, TrimMode=2)  # -> ListA, ListB
xprod = CrossProduct(VectorA=Z, VectorB=vec2pt_3.Vector, Unitize=False)  # -> Vector, Length
item = ListItem(List=ccx.Points, Index=0, Wrap=True)  # -> Item, Item1
ln = Line(StartPoint=short.ListA, EndPoint=short.ListB)  # -> flatten(Line)
rev = Reverse(Vector=xprod.Vector)
angle = Angle(VectorA=rev, VectorB=previus_vector)  # -> Angle, Reflex
len = Length(Curve=ln)
ln_2 = Line(StartPoint=item.Item, EndPoint=item.Item1)
deg = Degrees(Radians=angle.Angle)
sort = SortList(Keys=len, ValuesA=ln)  # -> Keys, ValuesA
item_2 = ListItem(List=sort.ValuesA, Index=0, Wrap=True)
crv = Curve(item_2)
midpt = CurveMiddle(Curve=crv)
end = EndPoints(Curve=item_2)  # -> Start, End
larger = LargerThan(FirstNumber=deg, SecondNumber=Slider(90, range=0..100))  # -> LargerThan, OrEqualTo
flip = FlipCurve(Curve=item_2)  # -> Curve, Flag
division = Division(A=Slider(4, range=0..20), B=Slider(2, range=0..10000))
pt_7 = Point(Point(0, 0, 0))
python = GhPythonScript(x=larger.LargerThan, y=rev)  # -> out, a
# ---------- python: Python ----------
__author__ = "junho"
__version__ = "2020.03.31"

import rhinoscriptsyntax as rs
import ghpythonlib.components as ghcomp
if x:
    
    a=ghcomp.Reverse(y)
    
    
else:
    a=y
# ---------- end python ----------
expression = Expression(x=larger.LargerThan, Expression="If(x=true, 1, 0)")
ins = InsertItems(List=crv, Item=flip.Curve, Indices=1, Wrap=True)
vec2pt_4 = Vector2Pt(PointA=pt_7, PointB=python.a, Unitize=False)  # -> Vector, Length
multiplication_2 = Multiplication(A=vec2pt_4.Vector, B=division)
move = Move(Geometry=midpt, Motion=multiplication_2)  # -> Geometry, Transform
len_2 = Length(Curve=item_2)
item_3 = ListItem(List=ins, Index=expression, Wrap=True)
number_slider_8 = Slider(10, range=0..10)
dist_2 = Distance(PointA=pt_4, PointB=move.Geometry)
division_2 = Division(A=len_2, B=2)
smaller = SmallerThan(FirstNumber=dist_2, SecondNumber=division_2)  # -> SmallerThan, OrEqualTo
fastloopend = FastLoopEnd(
    port=fastloopstart.port,
    Exit=smaller.SmallerThan,
    Data=move.Geometry,
    Data_2=multiplication_2,
    Data_3=item_3,
    RecordData=True,
    TimeOutVal=0)  # -> D0, D1, D2
geo = Geometry(fastloopend.D0)
browse = BrowseHistory(Iteration=Slider(88, range=0..600), Data_0=fastloopend.D2)
geo_2 = Geometry(fastloopend.D2)
data = Data(flatten(geo))
shift_2 = ShiftList(List=data, Shift=1, Wrap=Toggle(False))
short_2 = ShortestList(ListA=data, ListB=shift_2, TrimMode=2)  # -> ListA, ListB
ln_3 = Line(StartPoint=start_pt_4, EndPoint=pt_4)
vec2pt_5 = Vector2Pt(PointA=start_pt_4, PointB=pt_4, Unitize=False)  # -> Vector, Length
Z_2 = UnitZ(Factor=1)
ln_4 = Line(StartPoint=data, EndPoint=shift_2)
vec2pt_6 = Vector2Pt(PointA=short_2.ListA, PointB=short_2.ListB, Unitize=False)  # -> Vector, Length
divdist = DivideDistance(Curve=flatten(geo_2), Distance=number_slider_7)  # -> Points, Tangents, Parameters
project_2 = ProjectPoint(Point=geo, Direction=Vector(0, 0, 1), Geometry=srf_4)  # -> Point, Index
data_2 = Data(flatten(project_2.Point))
divide = DivideCurve(Curve=flatten(geo_2), Count=Slider(20, range=0..100), Kinks=False)  # -> Points, Tangents, Parameters
divlength = DivideLength(Curve=flatten(geo_2), Length=Slider(1, range=0..1))  # -> Points, Tangents, Parameters
move_2 = Move(Motion=Vector(0, 0, 10))  # -> Geometry, Transform
lng = ListLength(List=divdist.Points)
shift_3 = ShiftList(List=data_2, Shift=1, Wrap=False)
number_slider_9 = Slider(3, range=0..3)
lng_2 = ListLength(List=divdist.Points)
project_3 = ProjectPoint(Point=divide.Points, Direction=Z_2, Geometry=srf_4)  # -> Point, Index
number_slider_10 = Slider(4, range=0..10)
path_mapper = PathMapper(project_3.Point, source="{a;b}(i)", target="{a;i}(b)")
project_4 = Project(Plane=PlaneXY(0, 0, 0))  # -> Geometry, Transform
short_3 = ShortestList(ListA=data_2, ListB=shift_3, TrimMode=2)  # -> ListA, ListB
bnd = Bounds(Numbers=flatten(lng))
angle_2 = Angle(VectorA=vec2pt_6.Vector, VectorB=vec2pt_5.Vector)  # -> Angle, Reflex
ln_5 = Line(StartPoint=data_2, EndPoint=shift_3)
vec2pt_7 = Vector2Pt(PointA=short_3.ListA, PointB=short_3.ListB, Unitize=False)  # -> Vector, Length
angle_3 = Angle(VectorA=vec2pt_7.Vector, VectorB=vec2pt_6.Vector)  # -> Angle, Reflex
nurbs = NurbsCurve(Vertices=path_mapper, Degree=3, Periodic=False)  # -> Curve, Length, Domain
dedomain_4 = DeconstructDomain(Domain=bnd)  # -> Start, End
subtraction = Subtraction(A=lng_2, B=dedomain_4.Start)
reduce = RandomReduce(List=divdist.Points, Reduction=subtraction, Seed=Slider(1, range=0..10))
trim = TrimTree(Tree=reduce, Depth=1)
project_5 = ProjectPoint(Point=trim, Direction=Z_2, Geometry=srf_4)  # -> Point, Index
path_mapper_2 = PathMapper(project_5.Point, source="{a;b}(i)", target="{a;i}(b)")
nurbs_2 = NurbsCurve(Vertices=path_mapper_2, Degree=3, Periodic=False)  # -> Curve, Length, Domain
Z_3 = UnitZ(Factor=1)
fit = FitCurve(Curve=nurbs.Curve, Degree=number_slider_10, Tolerance=number_slider_9)
fit_2 = FitCurve(Curve=nurbs_2.Curve, Degree=number_slider_10, Tolerance=number_slider_9)  # -> flatten(Curve)
lng_3 = ListLength(List=fit_2)
panel = Panel(lng_3)
lng_4 = ListLength(List=reduce)
panel_2 = Panel(lng_4)
move_3 = Move(Geometry=trim, Motion=Z_3)  # -> Geometry, Transform
random = Random(Range=Domain(0, 1), Number=lng_3, Seed=2)
multiplication_3 = Multiplication(A=random, B=Slider(3, range=0..50))
Z_4 = UnitZ(Factor=multiplication_3)
move_4 = Move(Geometry=fit_2, Motion=Z_4)  # -> Geometry, Transform
cos = Cosine(Value=degrees(angle_3.Angle))
cos_2 = Cosine(Value=degrees(angle_2.Angle))
multiplication_4 = Multiplication(A=cos, B=cos_2)
ma = MassAddition(Input=multiplication_4)  # -> Result, PartialResults
lng_5 = ListLength(List=cos_2)
division_3 = Division(A=ma.Result, B=lng_5)

# ----
xy_3 = XYPlane(Origin=Point(0, 0, 0))
bbox_2 = BoundingBox(Content=srf_2, Plane=xy_3, UnionBox=False)  # -> Box, Box_2
debox_2 = DeconstructBox(Box=bbox_2.Box)  # -> Plane, X, Y, Z
xy_4 = XYPlane(Origin=Point(0, 0, 0))
bbox_3 = BoundingBox(Content=srf, Plane=xy_4, UnionBox=False)  # -> Box, Box_2
debox_3 = DeconstructBox(Box=bbox_3.Box)  # -> Plane, X, Y, Z
vec2pt_8 = Vector2Pt(PointA=previus_pt_3, PointB=start_pt_3, Unitize=False)  # -> Vector, Length
dedomain_5 = DeconstructDomain(Domain=debox_2.X)  # -> Start, End
dedomain_6 = DeconstructDomain(Domain=debox_2.Z)  # -> Start, End
dedomain_7 = DeconstructDomain(Domain=debox_2.Y)  # -> Start, End
vec2pt_9 = Vector2Pt(PointA=previus_pt, PointB=start_pt, Unitize=False)  # -> Vector, Length
dedomain_8 = DeconstructDomain(Domain=debox_3.X)  # -> Start, End
dedomain_9 = DeconstructDomain(Domain=debox_3.Z)  # -> Start, End
dedomain_10 = DeconstructDomain(Domain=debox_3.Y)  # -> Start, End
xy_5 = XYPlane(Origin=Point(0, 0, 0))
bbox_4 = BoundingBox(Content=srf_3, Plane=xy_5, UnionBox=False)  # -> Box, Box_2
debox_4 = DeconstructBox(Box=bbox_4.Box)  # -> Plane, X, Y, Z
fastloopstart_2 = FastLoopStart(I=Slider(350, range=0..1000), D0=start_pt_3, D1=vec2pt_8.Vector)  # -> port, Counter, Data, Data_2, Data_3
fastloopstart_3 = FastLoopStart(I=Slider(300, range=0..1000), D0=start_pt, D1=vec2pt_9.Vector)  # -> port, Counter, Data, Data_2, Data_3
vec2pt_10 = Vector2Pt(PointA=previus_pt, PointB=fastloopstart_3.Data, Unitize=False)  # -> Vector, Length
pt_8 = ConstructPoint(XCoordinate=dedomain_5.Start, YCoordinate=dedomain_7.Start, ZCoordinate=dedomain_6.Start)
pt_9 = ConstructPoint(XCoordinate=dedomain_5.End, YCoordinate=dedomain_7.End, ZCoordinate=dedomain_6.End)
vec2pt_11 = Vector2Pt(PointA=previus_pt_2, PointB=start_pt_2, Unitize=False)  # -> Vector, Length
dedomain_11 = DeconstructDomain(Domain=debox_4.X)  # -> Start, End
dedomain_12 = DeconstructDomain(Domain=debox_4.Z)  # -> Start, End
dedomain_13 = DeconstructDomain(Domain=debox_4.Y)  # -> Start, End
pt_10 = ConstructPoint(XCoordinate=dedomain_8.Start, YCoordinate=dedomain_10.Start, ZCoordinate=dedomain_9.Start)
pt_11 = ConstructPoint(XCoordinate=dedomain_8.End, YCoordinate=dedomain_10.End, ZCoordinate=dedomain_9.End)
fastloopstart_4 = FastLoopStart(I=Slider(300, range=0..1000), D0=start_pt_2, D1=vec2pt_11.Vector)  # -> port, Counter, Data, Data_2, Data_3
xy_6 = XYPlane(Origin=Point(0, 0, 0))
dist_3 = Distance(PointA=pt_8, PointB=pt_9)
multiplication_5 = Multiplication(A=dist_3, B=2)
pt_12 = ConstructPoint(XCoordinate=dedomain_11.Start, YCoordinate=dedomain_13.Start, ZCoordinate=dedomain_12.Start)
pt_13 = ConstructPoint(XCoordinate=dedomain_11.End, YCoordinate=dedomain_13.End, ZCoordinate=dedomain_12.End)
project_6 = Project(Geometry=srf_2, Plane=xy_6)  # -> Geometry, Transform
xy_7 = XYPlane(Origin=Point(0, 0, 0))
dist_4 = Distance(PointA=pt_10, PointB=pt_11)
multiplication_6 = Multiplication(A=dist_4, B=2)
project_7 = Project(Geometry=srf, Plane=xy_7)  # -> Geometry, Transform
wires_2 = BrepWireframe(Brep=project_6.Geometry, Density=-1)
edges_2 = BrepEdges(Brep=project_6.Geometry)  # -> Naked, Interior, NonManifold
xy_8 = XYPlane(Origin=Point(0, 0, 0))
wires_3 = BrepWireframe(Brep=project_7.Geometry, Density=-1)
dist_5 = Distance(PointA=pt_12, PointB=pt_13)
multiplication_7 = Multiplication(A=dist_5, B=2)
edges_3 = BrepEdges(Brep=project_7.Geometry)  # -> Naked, Interior, NonManifold
project_8 = Project(Geometry=srf_3, Plane=xy_8)  # -> Geometry, Transform
join_2 = JoinCurves(Curves=edges_3.Naked, Preserve=False)
crv_cp_2 = CurveClosestPoint(Point=fastloopstart_3.Data, Curve=join_2)  # -> Point, Parameter, Distance
vec2pt_12 = Vector2Pt(PointA=crv_cp_2.Point, PointB=fastloopstart_3.Data, Unitize=False)  # -> Vector, Length
line_2 = LineSDL(Start=crv_cp_2.Point, Direction=vec2pt_12.Vector, Length=dist_4)
wires_4 = BrepWireframe(Brep=project_8.Geometry, Density=-1)
previus_vector_2 = Vector(fastloopstart_2.Data_2)
join_3 = JoinCurves(Curves=edges_2.Naked, Preserve=False)
crv_cp_3 = CurveClosestPoint(Point=fastloopstart_2.Data, Curve=join_3)  # -> Point, Parameter, Distance
vec2pt_13 = Vector2Pt(PointA=crv_cp_3.Point, PointB=fastloopstart_2.Data, Unitize=False)  # -> Vector, Length
line_3 = LineSDL(Start=crv_cp_3.Point, Direction=vec2pt_13.Vector, Length=dist_3)
ccx_2 = CurveCurve(CurveA=line_3, CurveB=join_3)  # -> Points, ParamsA, ParamsB
edges_4 = BrepEdges(Brep=project_8.Geometry)  # -> Naked, Interior, NonManifold
Z_5 = UnitZ(Factor=1)
Z_6 = UnitZ(Factor=1)
join_4 = JoinCurves(Curves=edges_4.Naked, Preserve=False)
crv_cp_4 = CurveClosestPoint(Point=fastloopstart_4.Data, Curve=join_4)  # -> Point, Parameter, Distance
vec2pt_14 = Vector2Pt(PointA=crv_cp_4.Point, PointB=fastloopstart_4.Data, Unitize=False)  # -> Vector, Length
line_4 = LineSDL(Start=crv_cp_4.Point, Direction=vec2pt_14.Vector, Length=dist_5)
previus_vector_3 = Vector(fastloopstart_3.Data_2)
xprod_2 = CrossProduct(VectorA=Z_5, VectorB=vec2pt_13.Vector, Unitize=False)  # -> Vector, Length
ccx_3 = CurveCurve(CurveA=line_2, CurveB=join_2)  # -> Points, ParamsA, ParamsB
item_4 = ListItem(List=ccx_2.Points, Index=0, Wrap=True)  # -> Item, Item1
xprod_3 = CrossProduct(VectorA=Z_6, VectorB=vec2pt_12.Vector, Unitize=False)  # -> Vector, Length
rev_2 = Reverse(Vector=xprod_2.Vector)
Z_7 = UnitZ(Factor=1)
item_5 = ListItem(List=ccx_3.Points, Index=0, Wrap=True)  # -> Item, Item1
rev_3 = Reverse(Vector=xprod_3.Vector)
angle_4 = Angle(VectorA=rev_2, VectorB=previus_vector_2)  # -> Angle, Reflex
previus_vector_4 = Vector(fastloopstart_4.Data_2)
ccx_4 = CurveCurve(CurveA=line_4, CurveB=join_4)  # -> Points, ParamsA, ParamsB
ln_6 = Line(StartPoint=item_4.Item, EndPoint=item_4.Item1)
xprod_4 = CrossProduct(VectorA=Z_7, VectorB=vec2pt_14.Vector, Unitize=False)  # -> Vector, Length
angle_5 = Angle(VectorA=rev_3, VectorB=previus_vector_3)  # -> Angle, Reflex
deg_2 = Degrees(Radians=angle_4.Angle)
ln_7 = Line(StartPoint=item_5.Item, EndPoint=item_5.Item1)
number_slider_11 = Slider(2, range=0..10000)
item_6 = ListItem(List=ccx_4.Points, Index=0, Wrap=True)  # -> Item, Item1
rev_4 = Reverse(Vector=xprod_4.Vector)
crv_2 = Curve(ln_6)
deg_3 = Degrees(Radians=angle_5.Angle)
larger_2 = LargerThan(FirstNumber=deg_2, SecondNumber=Slider(90, range=0..100))  # -> LargerThan, OrEqualTo
angle_6 = Angle(VectorA=rev_4, VectorB=previus_vector_4)  # -> Angle, Reflex
crv_3 = Curve(ln_7)
flip_2 = FlipCurve(Curve=ln_6)  # -> Curve, Flag
ln_8 = Line(StartPoint=item_6.Item, EndPoint=item_6.Item1)
larger_3 = LargerThan(FirstNumber=deg_3, SecondNumber=Slider(90, range=0..100))  # -> LargerThan, OrEqualTo
deg_4 = Degrees(Radians=angle_6.Angle)
python_2 = GhPythonScript(x=larger_2.LargerThan, y=rev_2)  # -> out, a; same code as python
pt_14 = Point(Point(0, 0, 0))
flip_3 = FlipCurve(Curve=ln_7)  # -> Curve, Flag
expression_2 = Expression(x=larger_2.LargerThan, Expression="If(x=true, 1, 0)")
crv_4 = Curve(ln_8)
ins_2 = InsertItems(List=crv_2, Item=flip_2.Curve, Indices=1, Wrap=True)
division_4 = Division(A=Slider(1, range=0..1), B=number_slider_6)
python_3 = GhPythonScript(x=larger_3.LargerThan, y=rev_3)  # -> out, a; same code as python
pt_15 = Point(Point(0, 0, 0))
larger_4 = LargerThan(FirstNumber=deg_4, SecondNumber=Slider(90, range=0..100))  # -> LargerThan, OrEqualTo
expression_3 = Expression(x=larger_3.LargerThan, Expression="If(x=true, 1, 0)")
ins_3 = InsertItems(List=crv_3, Item=flip_3.Curve, Indices=1, Wrap=True)
vec2pt_15 = Vector2Pt(PointA=pt_14, PointB=python_2.a, Unitize=False)  # -> Vector, Length
multiplication_8 = Multiplication(A=vec2pt_15.Vector, B=division_4)
division_5 = Division(A=Slider(1, range=0..1), B=number_slider_2)
flip_4 = FlipCurve(Curve=ln_8)  # -> Curve, Flag
ln_9 = Line(StartPoint=start_pt_3, EndPoint=pt_3)
# direct line
vec2pt_16 = Vector2Pt(PointA=start_pt_3, PointB=pt_3, Unitize=False)  # -> Vector, Length
python_4 = GhPythonScript(x=larger_4.LargerThan, y=rev_4)  # -> out, a; same code as python
vec2pt_17 = Vector2Pt(PointA=pt_15, PointB=python_3.a, Unitize=False)  # -> Vector, Length
multiplication_9 = Multiplication(A=vec2pt_17.Vector, B=division_5)
expression_4 = Expression(x=larger_4.LargerThan, Expression="If(x=true, 1, 0)")
len_3 = Length(Curve=ln_6)
item_7 = ListItem(List=ins_2, Index=expression_2, Wrap=True)
pt_16 = Point(Point(0, 0, 0))
move_5 = Move(Geometry=fastloopstart_2.Data, Motion=multiplication_8)  # -> Geometry, Transform
ins_4 = InsertItems(List=crv_4, Item=flip_4.Curve, Indices=1, Wrap=True)
division_6 = Division(A=Slider(1, range=0..1), B=number_slider_4)
number_slider_12 = Slider(10, range=0..10)
len_4 = Length(Curve=ln_7)
item_8 = ListItem(List=ins_3, Index=expression_3, Wrap=True)
vec2pt_18 = Vector2Pt(PointA=pt_16, PointB=python_4.a, Unitize=False)  # -> Vector, Length
move_6 = Move(Geometry=fastloopstart_3.Data, Motion=multiplication_9)  # -> Geometry, Transform
multiplication_10 = Multiplication(A=vec2pt_18.Vector, B=division_6)
division_7 = Division(A=len_3, B=1.3)
number_slider_13 = Slider(10, range=0..10)
dist_6 = Distance(PointA=pt_3, PointB=move_5.Geometry)
len_5 = Length(Curve=ln_8)
item_9 = ListItem(List=ins_4, Index=expression_4, Wrap=True)
move_7 = Move(Geometry=fastloopstart_4.Data, Motion=multiplication_10)  # -> Geometry, Transform
dist_7 = Distance(PointA=pt, PointB=move_6.Geometry)
division_8 = Division(A=len_4, B=2)
smaller_2 = SmallerThan(FirstNumber=dist_6, SecondNumber=division_7)  # -> SmallerThan, OrEqualTo
fastloopend_2 = FastLoopEnd(
    port=fastloopstart_2.port,
    Exit=smaller_2.SmallerThan,
    Data=move_5.Geometry,
    Data_2=multiplication_8,
    Data_3=item_7,
    RecordData=True,
    TimeOutVal=0)  # -> D0, D1, D2
panel_3 = Panel(fastloopend_2.D1)
geo_3 = Geometry(fastloopend_2.D0)
data_3 = Data(flatten(geo_3))
shift_4 = ShiftList(List=data_3, Shift=1, Wrap=Toggle(False))
# planar line
short_4 = ShortestList(ListA=data_3, ListB=shift_4, TrimMode=2)  # -> ListA, ListB
ln_10 = Line(StartPoint=data_3, EndPoint=shift_4)
vec2pt_19 = Vector2Pt(PointA=short_4.ListA, PointB=short_4.ListB, Unitize=False)  # -> Vector, Length
project_9 = ProjectPoint(Point=geo_3, Direction=Vector(0, 0, 1), Geometry=srf_2)  # -> Point, Index
data_4 = Data(flatten(project_9.Point))
shift_5 = ShiftList(List=data_4, Shift=1, Wrap=False)
number_slider_14 = Slider(10, range=0..10)
geo_4 = Geometry(fastloopend_2.D2)
short_5 = ShortestList(ListA=data_4, ListB=shift_5, TrimMode=2)  # -> ListA, ListB
Z_8 = UnitZ(Factor=1)
smaller_3 = SmallerThan(FirstNumber=dist_7, SecondNumber=division_8)  # -> SmallerThan, OrEqualTo
fastloopend_3 = FastLoopEnd(
    port=fastloopstart_3.port,
    Exit=smaller_3.SmallerThan,
    Data=move_6.Geometry,
    Data_2=multiplication_9,
    Data_3=item_8,
    RecordData=True,
    TimeOutVal=0)  # -> D0, D1, D2
panel_4 = Panel(fastloopend_3.D1)
geo_5 = Geometry(fastloopend_3.D0)
browse_2 = BrowseHistory(Iteration=0, Data_0=fastloopend_3.D0)
geo_6 = Geometry(fastloopend_3.D2)
data_5 = Data(flatten(geo_5))
dist_8 = Distance(PointA=pt_2, PointB=move_7.Geometry)
division_9 = Division(A=len_5, B=2)
angle_7 = Angle(VectorA=vec2pt_19.Vector, VectorB=vec2pt_16.Vector)  # -> Angle, Reflex
ln_11 = Line(StartPoint=data_4, EndPoint=shift_5)
# 3d line
vec2pt_20 = Vector2Pt(PointA=short_5.ListA, PointB=short_5.ListB, Unitize=False)  # -> Vector, Length
smaller_4 = SmallerThan(FirstNumber=dist_8, SecondNumber=division_9)  # -> SmallerThan, OrEqualTo
fastloopend_4 = FastLoopEnd(
    port=fastloopstart_4.port,
    Exit=smaller_4.SmallerThan,
    Data=move_7.Geometry,
    Data_2=multiplication_10,
    Data_3=item_9,
    RecordData=True,
    TimeOutVal=0)  # -> D0, D1, D2
geo_7 = Geometry(fastloopend_4.D0)
browse_3 = BrowseHistory(Iteration=0, Data_0=fastloopend_4.D0)
geo_8 = Geometry(fastloopend_4.D2)
shift_6 = ShiftList(List=data_5, Shift=1, Wrap=Toggle(False))
data_6 = Data(flatten(geo_7))
divdist_2 = DivideDistance(Curve=flatten(geo_4), Distance=number_slider_5)  # -> Points, Tangents, Parameters
angle_8 = Angle(VectorA=vec2pt_20.Vector, VectorB=vec2pt_19.Vector)  # -> Angle, Reflex
divide_2 = DivideCurve(Curve=flatten(geo_4), Count=Slider(20, range=0..100), Kinks=False)  # -> Points, Tangents, Parameters
divlength_2 = DivideLength(Curve=flatten(geo_4), Length=Slider(1, range=0..1))  # -> Points, Tangents, Parameters
move_8 = Move(Motion=Vector(0, 0, 10))  # -> Geometry, Transform
# planar line
short_6 = ShortestList(ListA=data_5, ListB=shift_6, TrimMode=2)  # -> ListA, ListB
ln_12 = Line(StartPoint=start_pt, EndPoint=pt)
# direct line
vec2pt_21 = Vector2Pt(PointA=start_pt, PointB=pt, Unitize=False)  # -> Vector, Length
cos_3 = Cosine(Value=degrees(angle_7.Angle))
ln_13 = Line(StartPoint=data_5, EndPoint=shift_6)
number_slider_15 = Slider(1, range=0..3)
shift_7 = ShiftList(List=data_6, Shift=1, Wrap=Toggle(False))
lng_6 = ListLength(List=divdist_2.Points)
cos_4 = Cosine(Value=degrees(angle_8.Angle))
lng_7 = ListLength(List=divdist_2.Points)
project_10 = ProjectPoint(Point=divide_2.Points, Direction=Z_8, Geometry=srf_2)  # -> Point, Index
vec2pt_22 = Vector2Pt(PointA=short_6.ListA, PointB=short_6.ListB, Unitize=False)  # -> Vector, Length
number_slider_16 = Slider(4, range=0..10)
path_mapper_3 = PathMapper(project_10.Point, source="{a;b}(i)", target="{a;i}(b)")
# planar line
short_7 = ShortestList(ListA=data_6, ListB=shift_7, TrimMode=2)  # -> ListA, ListB
multiplication_11 = Multiplication(A=cos_4, B=cos_3)
ln_14 = Line(StartPoint=start_pt_2, EndPoint=pt_2)
# direct line
vec2pt_23 = Vector2Pt(PointA=start_pt_2, PointB=pt_2, Unitize=False)  # -> Vector, Length
Z_9 = UnitZ(Factor=1)
project_11 = Project(Plane=PlaneXY(0, 0, 0))  # -> Geometry, Transform
ln_15 = Line(StartPoint=data_6, EndPoint=shift_7)
Z_10 = UnitZ(Factor=1)
project_12 = ProjectPoint(Point=geo_5, Direction=Vector(0, 0, 1), Geometry=srf)  # -> Point, Index
data_7 = Data(flatten(project_12.Point))
# added randomness
bnd_2 = Bounds(Numbers=flatten(lng_6))
vec2pt_24 = Vector2Pt(PointA=short_7.ListA, PointB=short_7.ListB, Unitize=False)  # -> Vector, Length
nurbs_3 = NurbsCurve(Vertices=path_mapper_3, Degree=3, Periodic=False)  # -> Curve, Length, Domain
lng_8 = ListLength(List=cos_3)
ma_2 = MassAddition(Input=multiplication_11)  # -> Result, PartialResults
shift_8 = ShiftList(List=data_7, Shift=1, Wrap=False)
dedomain_14 = DeconstructDomain(Domain=bnd_2)  # -> Start, End
subtraction_2 = Subtraction(A=lng_7, B=dedomain_14.Start)
reduce_2 = RandomReduce(List=divdist_2.Points, Reduction=subtraction_2, Seed=Slider(1, range=0..10))
divdist_3 = DivideDistance(Curve=flatten(geo_8), Distance=number_slider_3)  # -> Points, Tangents, Parameters
divdist_4 = DivideDistance(Curve=flatten(geo_6), Distance=number_slider)  # -> Points, Tangents, Parameters
project_13 = ProjectPoint(Point=geo_7, Direction=Vector(0, 0, 1), Geometry=srf_3)  # -> Point, Index
trim_2 = TrimTree(Tree=reduce_2, Depth=1)
project_14 = ProjectPoint(Point=trim_2, Direction=Z_8, Geometry=srf_2)  # -> Point, Index
path_mapper_4 = PathMapper(project_14.Point, source="{a;b}(i)", target="{a;i}(b)")
nurbs_4 = NurbsCurve(Vertices=path_mapper_4, Degree=3, Periodic=False)  # -> Curve, Length, Domain
division_10 = Division(A=ma_2.Result, B=lng_8)
data_8 = Data(flatten(project_13.Point))
divide_3 = DivideCurve(Curve=flatten(geo_8), Count=Slider(20, range=0..100), Kinks=False)  # -> Points, Tangents, Parameters
divide_4 = DivideCurve(Curve=flatten(geo_6), Count=Slider(20, range=0..100), Kinks=False)  # -> Points, Tangents, Parameters
Z_11 = UnitZ(Factor=1)
divlength_3 = DivideLength(Curve=flatten(geo_8), Length=Slider(1, range=0..1))  # -> Points, Tangents, Parameters
divlength_4 = DivideLength(Curve=flatten(geo_6), Length=Slider(1, range=0..1))  # -> Points, Tangents, Parameters
move_9 = Move(Motion=Vector(0, 0, 10))  # -> Geometry, Transform
move_10 = Move(Motion=Vector(0, 0, 10))  # -> Geometry, Transform
lng_9 = ListLength(List=reduce_2)
lng_10 = ListLength(List=divdist_3.Points)
shift_9 = ShiftList(List=data_8, Shift=1, Wrap=False)
short_8 = ShortestList(ListA=data_7, ListB=shift_8, TrimMode=2)  # -> ListA, ListB
number_slider_17 = Slider(3, range=0..3)
fit_3 = FitCurve(Curve=nurbs_4.Curve, Degree=number_slider_16, Tolerance=number_slider_15)
lng_11 = ListLength(List=divdist_4.Points)
fit_4 = FitCurve(Curve=nurbs_3.Curve, Degree=number_slider_16, Tolerance=number_slider_15)  # -> flatten(Curve)
number_slider_18 = Slider(1.4, range=0..3)
lng_12 = ListLength(List=fit_4)
panel_5 = Panel(lng_12)
lng_13 = ListLength(List=divdist_3.Points)
lng_14 = ListLength(List=divdist_4.Points)
project_15 = ProjectPoint(Point=divide_3.Points, Direction=Z_9, Geometry=srf_3)  # -> Point, Index
project_16 = ProjectPoint(Point=divide_4.Points, Direction=Z_10, Geometry=srf)  # -> Point, Index
angle_9 = Angle(VectorA=vec2pt_22.Vector, VectorB=vec2pt_21.Vector)  # -> Angle, Reflex
panel_6 = Panel(lng_9)
number_slider_19 = Slider(4, range=0..10)
move_11 = Move(Geometry=trim_2, Motion=Z_11)  # -> Geometry, Transform
path_mapper_5 = PathMapper(project_15.Point, source="{a;b}(i)", target="{a;i}(b)")
ln_16 = Line(StartPoint=data_7, EndPoint=shift_8)
path_mapper_6 = PathMapper(project_16.Point, source="{a;b}(i)", target="{a;i}(b)")
# 3d line
vec2pt_25 = Vector2Pt(PointA=short_8.ListA, PointB=short_8.ListB, Unitize=False)  # -> Vector, Length
angle_10 = Angle(VectorA=vec2pt_25.Vector, VectorB=vec2pt_22.Vector)  # -> Angle, Reflex
random_2 = Random(Range=Domain(0, 1), Number=lng_12, Seed=2)
project_17 = Project(Plane=PlaneXY(0, 0, 0))  # -> Geometry, Transform
multiplication_12 = Multiplication(A=random_2, B=Slider(3, range=0..50))
project_18 = Project(Plane=PlaneXY(0, 0, 0))  # -> Geometry, Transform
short_9 = ShortestList(ListA=data_8, ListB=shift_9, TrimMode=2)  # -> ListA, ListB
number_slider_20 = Slider(4, range=0..10)
Z_12 = UnitZ(Factor=multiplication_12)
bnd_3 = Bounds(Numbers=flatten(lng_10))
# added randomness
bnd_4 = Bounds(Numbers=flatten(lng_11))
angle_11 = Angle(VectorA=vec2pt_24.Vector, VectorB=vec2pt_23.Vector)  # -> Angle, Reflex
intcrv = Interpolate(Vertices=path_mapper_6, Degree=3, Periodic=False, KnotStyle=1)  # -> Curve, Length, Domain
ln_17 = Line(StartPoint=data_8, EndPoint=shift_9)
# 3d line
vec2pt_26 = Vector2Pt(PointA=short_9.ListA, PointB=short_9.ListB, Unitize=False)  # -> Vector, Length
angle_12 = Angle(VectorA=vec2pt_26.Vector, VectorB=vec2pt_24.Vector)  # -> Angle, Reflex
nurbs_5 = NurbsCurve(Vertices=path_mapper_5, Degree=3, Periodic=False)  # -> Curve, Length, Domain
nurbs_6 = NurbsCurve(Vertices=path_mapper_6, Degree=3, Periodic=False)  # -> Curve, Length, Domain
# added randomness
dedomain_15 = DeconstructDomain(Domain=bnd_3)  # -> Start, End
subtraction_3 = Subtraction(A=lng_13, B=dedomain_15.Start)
reduce_3 = RandomReduce(List=divdist_3.Points, Reduction=subtraction_3, Seed=Slider(1, range=0..10))
dedomain_16 = DeconstructDomain(Domain=bnd_4)  # -> Start, End
subtraction_4 = Subtraction(A=lng_14, B=dedomain_16.Start)
reduce_4 = RandomReduce(List=divdist_4.Points, Reduction=subtraction_4, Seed=Slider(1, range=0..10))
trim_3 = TrimTree(Tree=reduce_3, Depth=1)
project_19 = ProjectPoint(Point=trim_3, Direction=Z_9, Geometry=srf_3)  # -> Point, Index
path_mapper_7 = PathMapper(project_19.Point, source="{a;b}(i)", target="{a;i}(b)")
nurbs_7 = NurbsCurve(Vertices=path_mapper_7, Degree=3, Periodic=False)  # -> Curve, Length, Domain
Z_13 = UnitZ(Factor=1)
fit_5 = FitCurve(Curve=nurbs_5.Curve, Degree=number_slider_19, Tolerance=number_slider_17)
fit_6 = FitCurve(Curve=nurbs_7.Curve, Degree=number_slider_19, Tolerance=number_slider_17)  # -> flatten(Curve)
lng_15 = ListLength(List=fit_6)
panel_7 = Panel(lng_15)
lng_16 = ListLength(List=reduce_3)
panel_8 = Panel(lng_16)
move_12 = Move(Geometry=trim_3, Motion=Z_13)  # -> Geometry, Transform
random_3 = Random(Range=Domain(0, 1), Number=lng_15, Seed=2)
multiplication_13 = Multiplication(A=random_3, B=Slider(3, range=0..50))
Z_14 = UnitZ(Factor=multiplication_13)
move_13 = Move(Geometry=fit_6, Motion=Z_14)  # -> Geometry, Transform
move_14 = Move(Geometry=fit_4, Motion=Z_12)  # -> Geometry, Transform
trim_4 = TrimTree(Tree=reduce_4, Depth=1)
project_20 = ProjectPoint(Point=trim_4, Direction=Z_10, Geometry=srf)  # -> Point, Index
path_mapper_8 = PathMapper(project_20.Point, source="{a;b}(i)", target="{a;i}(b)")
nurbs_8 = NurbsCurve(Vertices=path_mapper_8, Degree=3, Periodic=False)  # -> Curve, Length, Domain
cos_5 = Cosine(Value=degrees(angle_10.Angle))
cos_6 = Cosine(Value=degrees(angle_9.Angle))
fit_7 = FitCurve(Curve=nurbs_6.Curve, Degree=number_slider_20, Tolerance=number_slider_18)
Z_15 = UnitZ(Factor=1)
fit_8 = FitCurve(Curve=nurbs_8.Curve, Degree=number_slider_20, Tolerance=number_slider_18)  # -> flatten(Curve)
lng_17 = ListLength(List=fit_8)
panel_9 = Panel(lng_17)
lng_18 = ListLength(List=reduce_4)
multiplication_14 = Multiplication(A=cos_5, B=cos_6)
cos_7 = Cosine(Value=degrees(angle_12.Angle))
cos_8 = Cosine(Value=degrees(angle_11.Angle))
panel_10 = Panel(lng_18)
move_15 = Move(Geometry=trim_4, Motion=Z_15)  # -> Geometry, Transform
random_4 = Random(Range=Domain(0, 1), Number=lng_17, Seed=2)
ma_3 = MassAddition(Input=multiplication_14)  # -> Result, PartialResults
lng_19 = ListLength(List=cos_6)
multiplication_15 = Multiplication(A=random_4, B=Slider(3, range=0..50))
Z_16 = UnitZ(Factor=multiplication_15)
multiplication_16 = Multiplication(A=cos_7, B=cos_8)
move_16 = Move(Geometry=fit_8, Motion=Z_16)  # -> Geometry, Transform
ma_4 = MassAddition(Input=multiplication_16)  # -> Result, PartialResults
lng_20 = ListLength(List=cos_8)
division_11 = Division(A=ma_3.Result, B=lng_19)
division_12 = Division(A=ma_4.Result, B=lng_20)

# ==== cluster Cluster
pt = ClusterInput()
crv = ClusterInput()
pt_2 = Point(pt)
crv_2 = Curve(crv)
pi = Pi(Factor=1)
number_slider = Slider(100, range=0..1000)
multiplication = Multiplication(A=pi, B=2)
division = Division(A=multiplication, B=number_slider)
series = Series(Start=0, Step=division, Count=number_slider)
sin = Sine(Value=series)
cos = Cosine(Value=series)
pt_3 = Point(Point(0, 0, 0))
pt_4 = ConstructPoint(XCoordinate=cos, YCoordinate=sin, ZCoordinate=0)
L = ClusterInput()
vec2pt = Vector2Pt(PointA=pt_3, PointB=pt_4, Unitize=False)  # -> Vector, Length
line = LineSDL(Start=pt_2, Direction=vec2pt.Vector, Length=L)
end = EndPoints(Curve=line)  # -> Start, End
eval = EvaluateCurve(Curve=line, Parameter=Slider(0.5, range=0..1))  # -> Point, Tangent, Angle
vec2pt_2 = Vector2Pt(PointA=eval.Point, PointB=end.Start, Unitize=False)  # -> Vector, Length
move = Move(Geometry=line, Motion=vec2pt_2.Vector)  # -> Geometry, Transform
python = GhPythonScript(x=crv_2, y=move.Geometry)  # -> out, a, intersections; inputs y: list
# ---------- python: Python ----------
__author__ = "junho"
__version__ = "2020.03.31"

import rhinoscriptsyntax as rs
import Rhino
import ghpythonlib.components as ghcomp
doc= Rhino.RhinoDoc.ActiveDoc


def CrvCrvListIntersection(a,b):
    intersections = []
    ghcrv=rs.coercecurve(a)
    for j in b:
        ghobj=rs.coerceline(j)
        cl=ghcomp.CurveXLine(ghcrv,ghobj)
        intersections.append(cl[0])
        
    return intersections;
if __name__=="__main__":
    intersections=CrvCrvListIntersection(x,y)
# ---------- end python ----------
# for debug
crv_3 = Curve(<curve referenced from the Rhino model>)
line_2 = Line(Line((6516.140707, 268.3551164, 0), (6513.137732, 280.1254029, 0)))
ccx = CurveCurve(CurveA=crv_2, CurveB=move.Geometry)  # -> Points, ParamsA, ParamsB
lng = ListLength(List=ccx.Points)
python_2 = GhPythonScript(x=ccx.Points, y=pt_2)  # -> out, a; inputs x: list
# ---------- python_2: Python ----------
__author__ = "junho"
__version__ = "2020.03.31"
        
import rhinoscriptsyntax as rs
import ghpythonlib.components as ghcomp
        
def SelectTwo(list,pt):
    dislist=[]
    temp_out = []
    gh_refpt=rs.coerce3dpointlist(list)
    pt = rs.coerce3dpoint(pt)
            
    for refpt in gh_refpt:
        dislist.append(rs.Distance(refpt,pt))
                
    minimum = +float('inf')
    index=-1
    min_index=0
    for i in dislist: 
        index=index+1
        if i< minimum:
            minimum=i
            min_index=index
                       
    diflist=[]         
    
    for dis_index in range(len(dislist)):

        pt_cord=ghcomp.Deconstruct(gh_refpt[dis_index])
        ref_cord=ghcomp.Deconstruct(pt)
        diflist.append(difBetweenPt(pt_cord,ref_cord))
    print(diflist)
    
    second = +float('inf')
    index=-1    
    for dis in dislist:
        index=index+1
        if index==min_index:
            pass
            print("passed")
        elif minimum< dis <second and isOpposite(diflist[min_index],diflist[index]):
            second = dis 
        print("second",second)
    for dis_index in range(len(dislist)):
        if dislist[dis_index]==minimum or dislist[dis_index]==second:
            temp_out.append(gh_refpt[dis_index])           
    return temp_out       
        
def difBetweenPt(pt_1,pt_2):
    dif = []
            
    for i in range(3):

        dif.append(pt_1[i]-pt_2[i])      
    return dif       
def isOpposite(dif_1,dif_2):
    # dif_1,2 are length 3 lists. 
    isOppo=False
    
    if dif_1[0] ==0: 
        isOppo= dif_1[1] * dif_2[1] <0
        print("parallel to y")
    elif dif_1[1]==0:
        isOppo=dif_1[0]* dif_2[0]<0   
        print("parallel to x")
    else:       
        isOppo = dif_1[1] * dif_2[1] <0
        print(dif_1, dif_2)       
        print(isOppo)
    return isOppo
            
if __name__=="__main__":
    if len(x)>=3:
                
        a = SelectTwo(x,y)
    else:
        a = x
# ---------- end python_2 ----------
a = ClusterOutput(python_2.a)
shift = ShiftList(List=python_2.a, Shift=1, Wrap=False)
panel = Panel(python_2.a)
short = ShortestList(ListA=python_2.a, ListB=shift, TrimMode=2)  # -> ListA, ListB
ln = Line(StartPoint=short.ListA, EndPoint=short.ListB)
